# Grasshopper definition deployableFacade.gh (Grasshopper 0.9.76)
# Copyright: Adrien Rigobello
# plug-ins: Kangaroo2 Components

number_slider = Slider(2, range=0..10)
# Deployable Facade (Yeosu 2012 like)
# Adrien Rigobello, 2018
# adrien@thr34d5.org
number_slider_2 = Slider(5, range=0..10)

# ----
# 0. start the simulation at 0°
# 1. reset
# 2. toggle to True
# 3. augment slowly the degrees
reset = Button()
run_kangaroo = BooleanToggle(False)

number_slider_3 = Slider(15, range=0..100)
multiplication = Multiplication(A=number_slider_2, B=number_slider)
pt = ConstructPoint(XCoordinate=number_slider_2, YCoordinate=multiplication, ZCoordinate=0)
rec_2pt = Rectangle2Pt(Plane=PlaneXY(0, 0, 0), PointA=Point(0, 0, 0), PointB=pt, Radius=0)  # -> Rectangle, Length
multiplication_2 = Multiplication(A=number_slider_3, B=number_slider)
sdivide = DivideSurface(Surface=rec_2pt.Rectangle, UCount=number_slider_3, VCount=multiplication_2)  # -> Points, Normals, Parameters
explode = Explode(Curve=rec_2pt.Rectangle, Recursive=True)  # -> Segments, Vertices
del = DelaunayMesh(Points=flatten(sdivide.Points), Plane=PlaneXY(0, 0, 0))
rad = Radians(Degrees=Slider(0, range=0..100))
item = ListItem(List=explode.Vertices, Index=0, Wrap=True)  # -> Item, Item1, Item2, Item3
xy = XYPlane(Origin=[item.Item1, item.Item2])
neg = Negative(Value=rad)
Z = UnitZ(Factor=Slider(0.05, range=0..0.1))
rotate = Rotate(
    Geometry=simplify(graft([item.Item, item.Item3])),
    Angle=expr("-x", simplify(graft([rad, neg]))),
    Plane=simplify(graft(xy)))  # -> Geometry, Transform
number_slider_4 = Slider(500, range=0..1000)
demesh = DeconstructMesh(Mesh=del)  # -> Vertices, Faces, Colours, Normals
edgelengths = EdgeLengths(Mesh=del, LengthFactor=Slider(1, range=0..1), Strength=number_slider_4)
anchor = Anchor(Point=flatten([item.Item, item.Item3]), Target=flatten(rotate.Geometry), Strength=Slider(1000, range=0..1000))
anchor_2 = Anchor(Point=flatten([item.Item1, item.Item2]), Strength=number_slider_4)
smooth = Smooth(M=del, Strength=Slider(10, range=0..10))
load = Load(Point=demesh.Vertices, ForceVector=Z)
show = Show(G=del)
merge = Merge(Data1=show, Data2=edgelengths, Data3=anchor_2, Data4=load, Data5=anchor, Data6=smooth)  # -> flatten(Result)
solver = Solver(GoalObjects=merge, Reset=reset, Threshold=1e-15, Tolerance=0.01, On=run_kangaroo)  # -> I, V, O
geo = Geometry(solver.O)
