# Grasshopper definition scaltransStripes.gh (Grasshopper 0.9.76)
# plug-ins: Python Interpreter, LunchBox

# ----
# Scaltrans surface to laser cutting stripes with flaps
# Adrien Rigobello, 2016
# adrien@thr34d5.org
number_slider = Slider(8, range=0..10)
number_slider_2 = Slider(16, range=0..100)
expression = Expression(x=Slider(100, range=0..100), Expression="2*π*x")
srf = Surface(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)
sdivide = DivideSurface(Surface=srf, UCount=number_slider, VCount=number_slider_2)  # -> Points, Normals, Parameters
flip = FlipMatrix(Data=sdivide.Points)
python = PythonScript(Pts=flatten(flip), nU=number_slider, nV=number_slider_2)  # -> out, FinalMesh, Strips, Brep; inputs Pts: list of Point3d, nU: Int32, nV: Int32
# ---------- python: Python ----------
import rhinoscriptsyntax as rs
Flip=(nU>nV)
Faces=[]
Strips=[]
Brep=[]
for i in range(0,nV):
    for j in range(0,nU):
        Faces.append([i*(nU+1)+j,i*(nU+1)+j+1,(i+1)*(nU+1)+j+1,(i+1)*(nU+1)+j])
if Flip:
    for i in range(0,nV):
        Faces0=[]
        temp=[]
        for j in range(0,nU):
            Faces0.append([i*(nU+1)+j,i*(nU+1)+j+1,(i+1)*(nU+1)+j+1,(i+1)*(nU+1)+j])
            temp.append(rs.AddSrfPt([Pts[i*(nU+1)+j],Pts[i*(nU+1)+j+1],Pts[(i+1)*(nU+1)+j+1],Pts[(i+1)*(nU+1)+j]]))
        Strips.append(rs.AddMesh(Pts,Faces0))
        Brep.append(rs.JoinSurfaces(temp))
else:
    for j in range(0,nU):
        Faces0=[]
        temp=[]
        for i in range(0,nV):
            Faces0.append([i*(nU+1)+j,i*(nU+1)+j+1,(i+1)*(nU+1)+j+1,(i+1)*(nU+1)+j])
            temp.append(rs.AddSrfPt([Pts[i*(nU+1)+j],Pts[i*(nU+1)+j+1],Pts[(i+1)*(nU+1)+j+1],Pts[(i+1)*(nU+1)+j]]))
        Strips.append(rs.AddMesh(Pts,Faces0))
        Brep.append(rs.JoinSurfaces(temp))
FinalMesh=rs.AddMesh(Pts,Faces)
# ---------- end python ----------
multiplication = Multiplication(A=Slider(36, range=0..100), B=Slider(1, range=0..100))
division = Division(A=expression, B=number_slider)
addition = Addition(A=division, B=multiplication)
lng = ListLength(List=python.Brep)
unroll = UnrollBrep(Brep=python.Brep, JoinUnrolled=False)
series = Series(Start=0, Step=addition, Count=lng)  # -> graft(Series)
X = UnitX(Factor=series)
move = Move(Geometry=unroll, Motion=X)  # -> Geometry, Transform
debrep = DeconstructBrep(Brep=move.Geometry)  # -> Faces, simplify(Edges), Vertices
lng_2 = ListLength(List=debrep.Edges)
equals = Equality(FirstNumber=lng_2, SecondNumber=Slider(3, range=0..10))  # -> Equality, Inequality
dispatch = Dispatch(List=debrep.Edges, DispatchPattern=equals.Inequality)  # -> ListA, ListB
item = ListItem(List=dispatch.ListA, Index=0, Wrap=True)  # -> Item, Item1, Item2, Item3
path_mapper = PathMapper(item.Item, source="{A;B}", target="{A}(B)")
path_mapper_2 = PathMapper(item.Item1, source="{A;B}", target="{A}(B)")
path_mapper_3 = PathMapper(item.Item2, source="{A;B}", target="{A}(B)")
path_mapper_4 = PathMapper(item.Item3, source="{A;B}", target="{A}(B)")
dispatch_2 = Dispatch(List=path_mapper, DispatchPattern=[True, False])  # -> ListA, ListB
dispatch_3 = Dispatch(List=path_mapper_2, DispatchPattern=[True, False])  # -> ListA, ListB
dispatch_4 = Dispatch(List=path_mapper_3, DispatchPattern=[True, False])  # -> ListA, ListB
dispatch_5 = Dispatch(List=path_mapper_4, DispatchPattern=[True, False])  # -> ListA, ListB

number_slider_3 = Slider(7, range=0..10)
toggle = BooleanToggle(True)
toggle_2 = BooleanToggle(True)
neg = Negative(Value=Slider(7, range=0..100))
offset = Offset(Curve=[dispatch_5.ListA, dispatch_3.ListB], Distance=neg, Plane=PlaneXY(0, 0, 0), Corners=1)  # -> simplify(Curve)
clean = CleanTree(RemoveNulls=toggle_2, RemoveInvalid=toggle_2, RemoveEmpty=toggle_2, Tree=dispatch_5.ListB)
cull_i = CullIndex(List=dispatch_4.ListB, Indices=number_slider_3, Wrap=True)
item_2 = ListItem(List=dispatch_4.ListB, Index=number_slider_3, Wrap=True)
clean_2 = CleanTree(RemoveNulls=toggle, RemoveInvalid=toggle, RemoveEmpty=toggle, Tree=dispatch_3.ListA)
end = EndPoints(Curve=dispatch_3.ListA)  # -> Start, End
item_3 = ListItem(List=dispatch_2.ListA, Index=0, Wrap=True)

# ---- group: flaps parameters
flaps_length = Slider(8, range=0..100)
flaps_width_scale = Slider(0.6, range=0..1)
material_thickness = Slider(3, range=0..10)

# ----
merge = Merge(Data1=clean_2, Data2=clean)  # -> graft(Result)
merge_2 = Merge(Data1=cull_i, Data2=dispatch_2.ListB)
curvepoint = PointOnCurve(offset, parameter=0.5)
offset_2 = Offset(Curve=merge, Distance=flaps_length, Plane=PlaneXY(0, 0, 0), Corners=1)  # -> simplify(Curve)
end_2 = EndPoints(Curve=merge)  # -> Start, End
curvepoint_2 = PointOnCurve(offset_2, parameter=0.5)
scale = Scale(Geometry=offset_2, Center=curvepoint_2, Factor=flaps_width_scale)  # -> Geometry, Transform
end_3 = EndPoints(Curve=scale.Geometry)  # -> Start, End
crv_cp = CurveClosestPoint(Point=simplify(end_3.Start), Curve=merge)  # -> Point, Parameter, Distance
crv_cp_2 = CurveClosestPoint(Point=end_3.End, Curve=merge)  # -> Point, Parameter, Distance
ln = Line(StartPoint=crv_cp.Point, EndPoint=end_3.Start)
ln_2 = Line(StartPoint=crv_cp_2.Point, EndPoint=end_2.End)
ln_3 = Line(StartPoint=crv_cp.Point, EndPoint=end_2.Start)
ln_4 = Line(StartPoint=end_3.End, EndPoint=crv_cp_2.Point)
scale_2 = Scale(Geometry=offset, Center=curvepoint, Factor=flaps_width_scale)  # -> Geometry, Transform
offset_3 = Offset(Curve=scale_2.Geometry, Distance=material_thickness, Plane=PlaneXY(0, 0, 0), Corners=1)
end_4 = EndPoints(Curve=scale_2.Geometry)  # -> Start, End
end_5 = EndPoints(Curve=offset_3)  # -> Start, End
merge_3 = Merge(Data1=ln, Data2=ln_4, Data3=scale.Geometry, Data4=ln_3, Data5=ln_2)
ln_5 = Line(StartPoint=end_4.Start, EndPoint=end_5.Start)
ln_6 = Line(StartPoint=end_4.End, EndPoint=end_5.End)
join = JoinCurves(Curves=merge_3, Preserve=False)  # -> simplify(Curves)
path_mapper_5 = PathMapper(join, source="{A;B}", target="{A}(B)")
merge_4 = Merge(Data1=dispatch_3.ListB, Data2=dispatch_5.ListA, Data3=path_mapper_5, Data4=item_2, Data5=item_3)

# ---- group: curves to laser cut
crv = Curve(merge_2)
join_2 = JoinCurves(Curves=[scale_2.Geometry, offset_3, ln_5, ln_6], Preserve=False)
join_3 = JoinCurves(Curves=merge_4, Preserve=False)  # -> simplify(Curves)
